# Grasshopper definition Dawei_Yang_A50.gh (Grasshopper 1.0.7)

panel = Panel("C:\_Work_Study\UCL_course\。intro for programming\A50\image_2021.png")
panel_2 = Panel("C:\_Work_Study\UCL_course\。intro for programming\A50\sunVectors.csv")
colour = Colour("145,0,119")
readsunvectors = CSharpScript(path=panel_2)  # -> out, sunVectors, A; inputs path: String
# ---------- readsunvectors: C# usings ----------
using System.IO;
# ---------- readsunvectors: C# ----------
    List<Vector3d> vec = GetVector(path);
    sunVectors = vec;
# ---------- readsunvectors: C# additional code ----------
  List<Vector3d> GetVector(string path)
  {
    string[] lines = File.ReadAllLines(path);
    List<Vector3d> vec = new List<Vector3d>();

    for (int i = 0; i < lines.Length; i++)
    {
      string[] cells = lines[i].Split(',');

      double x = double.Parse(cells[0]);
      double y = double.Parse(cells[1]);
      double z = double.Parse(cells[2]);

      Vector3d a = new Vector3d(x, y, z);
      vec.Add(a);

    }
    return vec;
  }
# ---------- end readsunvectors ----------
surfacefromimage = CSharpScript(
    path=panel,
    color=colour,
    degU=Slider(7, range=0..10),
    degV=Slider(8, range=0..10),
    GaussianFactor=Slider(4.638, range=0..10),
    roofHeight=Slider(3.558, range=0..10))  # -> out, srf, pixelPts; inputs path: String, color: Color, degU: Int32, degV: Int32, GaussianFactor: Double, roofHeight: Double
# ---------- surfacefromimage: C# usings ----------
using System.Drawing;
# ---------- surfacefromimage: C# ----------
    Node node = new Node();
    Bitmap bitmap = new Bitmap(path);

    List<Point3d> pts = node.GetNode(bitmap, color);
    double numX = new double();
    double numY = new double();
    node.GetXnumYnum(pts, ref numX, ref numY);
    int Xnum = (int) numX;
    int Ynum = (int) numY;

    NurbsSurface surface = NurbsSurface.CreateFromPoints(
      node.TransformNode(bitmap, color, GaussianFactor, roofHeight)
      , Xnum, Ynum, degU + 1, degV + 1);

    pixelPts = pts;
    srf = surface;

    Print(Xnum.ToString());
    Print(Ynum.ToString());
# ---------- surfacefromimage: C# additional code ----------
  public class Node
  {

    public List<Point3d> GetNode(Bitmap bitmap, System.Drawing.Color color)
    {
      List<Point3d> pts = new List<Point3d>();
      for (int i = 0; i < bitmap.Width; i++)
      {
        for (int j = 0; j < bitmap.Height; j++)
        {

          if (color == bitmap.GetPixel(i, j))
          {
            Point3d pt = new Point3d(i, -j, 0);
            pts.Add(pt);
          }
        }
      }
      return pts;
    }

    public void GetXnumYnum(List<Point3d> pts, ref double numX, ref double numY)
    {
      List<double> xCood = new List<double>();
      List<double> yCood = new List<double>();

      for (int i = 0; i < pts.Count; i++)
      {
        xCood.Add(pts[i].X);
        yCood.Add(pts[i].Y);
      }
      xCood.Sort();
      yCood.Sort();

      numX = xCood[pts.Count - 1] - xCood[0] + 1;
      numY = yCood[pts.Count - 1] - yCood[0] + 1;


    }

    public List<Point3d> TransformNode(Bitmap bitmap, System.Drawing.Color color, double GaussianFactor, double roofHeight)
    {
      List<Point3d> pts = new List<Point3d>();
      for (int i = 0; i < bitmap.Width; i++)
      {
        for (int j = 0; j < bitmap.Height; j++)
        {
          if (color == bitmap.GetPixel(i, j))
          {
            Point3d pt = new Point3d(i, -j, 0);

            pt.Z = GaussianFactor * Math.Exp(-Math.Pow((pt.Y + 8.5) / 3, 2)) + roofHeight;

            pts.Add(pt);
          }
        }
      }
      return pts;
    }

  }
# ---------- end surfacefromimage ----------
panel_3 = Panel(surfacefromimage.out)
surface = Surface(reparameterize(surfacefromimage.srf))
reset_walkers_strat_position = Button()
make_attractors_walk = BooleanToggle(True)

# ---- group: Attractors(Walkers) Strat Positions
md_slider = MDSlider(
    SliderMode=0,
    slider_value=Point(0.1189680099, 0.08672714233, 0.5),
    x_domain=Domain(0, 1),
    y_domain=Domain(0, 1),
    z_domain=Domain(0, 1))
md_slider_2 = MDSlider(
    SliderMode=0,
    slider_value=Point(0.8864573269, 0.9053136314, 0.5),
    x_domain=Domain(0, 1),
    y_domain=Domain(0, 1),
    z_domain=Domain(0, 1))

# ----
number_slider = Slider(15, range=0..50)
number_slider_2 = Slider(10, range=0..50)
trigger = Trigger(Interval=50, TimerInterval=50, Target=panelisesurface)  # disabled
panelisesurface = CSharpScript(
    srf=surface,
    xNum=number_slider_2,
    yNum=number_slider,
    sunVectors=readsunvectors.sunVectors,
    attractorsUV=[md_slider, md_slider_2],
    attractorsCanWalk=make_attractors_walk,
    step=Slider(0.03, range=0..0.2),
    reset=reset_walkers_strat_position)  # -> out, Meshes, attractorPoints, PanelHeight; inputs srf: Surface, xNum: Int32, yNum: Int32, sunVectors: list of Vector3d, attractorsUV: list of Point3d, attractorsCanWalk: Boolean, step: Double, reset: Boolean
# ---------- panelisesurface: C# ----------
    t = t + 1;
    if (t > 389)
    {
      t = 0;
    }

    Attractor att = new Attractor();
    if (attractorsCanWalk)//judge whether attractors can walk
    {
      if (reset)//make wakers start from attractorPoints
      {
        latestPositions = new List<Point3d>();
        UVPositions = new List<Point3d>();
        att.GetStartPts(ref latestPositions, ref UVPositions, attractorsUV, srf);
      }

      //use timer to make walker move
      for(int i = 0; i < attractorsUV.Count; i++)
      {
        UVPositions[i] = att.Walk(step, UVPositions[i]);
        UVPositions[i] = att.CheckBounds(UVPositions[i]);
        latestPositions[i] = srf.PointAt(UVPositions[i].X, UVPositions[i].Y);
      }
    }
    else
    {
      latestPositions = att.GetPosition(attractorsUV, srf);
    }

    Vector3d sunVec = sunVectors[t];
    Panel p = new Panel();
    List<double> FactorHeights;
    Mesh m = p.GetPanel(srf, xNum, yNum, sunVec, latestPositions, out FactorHeights);

    Meshes = m;
    attractorPoints = latestPositions;
    PanelHeight = FactorHeights;
# ---------- panelisesurface: C# additional code ----------
  static Random rand = new Random();
  int t = 0;
  List<Point3d> latestPositions;
  List<Point3d> UVPositions;


  public class Attractor
  {
    public void GetStartPts(ref List<Point3d> latestPositions, ref List<Point3d> UVPositions, List<Point3d> attractorsUV, Surface srf)
    {
      for(int i = 0; i < attractorsUV.Count; i++)
      {
        Point3d UVpt = new Point3d(attractorsUV[i].X, attractorsUV[i].Y, 0);
        Point3d Latestpt = srf.PointAt(UVpt.X, UVpt.Y);
        UVPositions.Add(UVpt);
        latestPositions.Add(Latestpt);
      }
    }

    public List<Point3d> GetPosition(List<Point3d> attractorsUV, Surface srf)
    {
      for (int i = 0; i < attractorsUV.Count; i++)
      {
        attractorsUV[i] = srf.PointAt(attractorsUV[i].X, attractorsUV[i].Y);
      }
      return attractorsUV;
    }

    public Point3d GetPosition(Point3d attractorsUV, Surface srf)
    {
      attractorsUV = srf.PointAt(attractorsUV.X, attractorsUV.Y);
      return attractorsUV;
    }

    public Point3d Walk(double stepSize, Point3d pos)
    {
      // select a direction
      int direction = rand.Next(4);
      if(direction == 0)
      {
        pos.Y += stepSize;
      }
      else if(direction == 1)
      {
        pos.Y -= stepSize;
      }
      else if(direction == 2)
      {
        pos.X += stepSize;
      }
      else
      {
        pos.X -= stepSize;
      }
      return pos;
    }

    public Point3d CheckBounds(Point3d Point)
    {
      if(Point.X > 1)
      {
        Point.X = 1;
        return Point;
      }
      else if(Point.X < 0)
      {
        Point.X = 0;
        return Point;
      }
      else if(Point.Y > 1)
      {
        Point.Y = 1;
        return Point;
      }
      else if(Point.Y < 0)
      {
        Point.Y = 0;
        return Point;
      }
      else return Point;
    }
  }


  public class Panel
  {
    public Mesh GetPanel(Surface srf, int xNum, int yNum, Vector3d sunVec, List<Point3d> attractorsUV, out List<double> FactorHeights)
    {
      Mesh m = new Mesh();
      FactorHeights = new List<double>();

      for (int i = 0; i < xNum ; i++)
      {
        for (int j = 0; j < yNum ; j++)
        {
          //calculate static vertices point of panel
          Point3d pointA = srf.PointAt(i / (double) xNum, j / (double) yNum);
          Point3d pointB = srf.PointAt(i / (double) xNum, (j + 1) / (double) yNum);
          Point3d pointC = srf.PointAt((i + 1) / (double) xNum, j / (double) yNum);
          Point3d pointD = srf.PointAt((i + 1) / (double) xNum, (j + 1) / (double) yNum);

          //calculate vector to generate PointE and pointF
          Vector3d vecAD = new Vector3d(pointD - pointA);
          Vector3d vecDA = new Vector3d(pointA - pointD);
          Vector3d vecBC = new Vector3d(pointB - pointC);
          Vector3d normal = Vector3d.CrossProduct(vecDA, vecBC);
          normal.Unitize();

          //calculate the factor to generate PointE and pointF
          Point3d center = (pointA + pointD) / 2;
          double distance = GetMinDistance(attractorsUV, center);
          double FactorHeight = remapDistance(distance, xNum, yNum) * 2;
          FactorHeights.Add(FactorHeight);
          double FactorOpen = 0.5 - Vector3d.VectorAngle(normal, sunVec) / Math.PI / 2;

          //calculate PointE and pointF
          Point3d pointE = pointA;
          Transform translateAD = Transform.Translation(FactorOpen * vecAD + FactorHeight * normal);
          pointE.Transform(translateAD);
          Point3d pointF = pointD;
          Transform translateDA = Transform.Translation(FactorOpen * vecDA + FactorHeight * normal);
          pointF.Transform(translateDA);

          //Add vertices
          m.Vertices.Add(pointA);
          m.Vertices.Add(pointB);
          m.Vertices.Add(pointC);
          m.Vertices.Add(pointD);
          m.Vertices.Add(pointE);
          m.Vertices.Add(pointF);
        }
      }

      //add index and build panel according index
      for (int i = 0; i < xNum ; i++)
      {
        for (int j = 0; j < yNum ; j++)
        {
          int a = (j + i * yNum) * 6;
          int b = (j + i * yNum) * 6 + 1;
          int c = (j + i * yNum) * 6 + 2;
          int d = (j + i * yNum) * 6 + 3;
          int e = (j + i * yNum) * 6 + 4;
          int f = (j + i * yNum) * 6 + 5;
          m.Faces.AddFace(a, b, e);
          m.Faces.AddFace(a, c, e);
          m.Faces.AddFace(d, b, f);
          m.Faces.AddFace(d, c, f);
        }
      }
      m.Normals.ComputeNormals();
      m.Compact();
      return m;
    }

    public double GetMinDistance(List<Point3d> attractorsUV, Point3d center)
    {
      List<double> distance = new List<double>();
      for (int i = 0; i < attractorsUV.Count; i++)
      {
        distance.Add(center.DistanceTo(attractorsUV[i]));
      }
      double minDistance = distance[0];

      for (int i = 1; i < distance.Count; i++)
      {
        if(minDistance > distance[i])
        {
          minDistance = distance[i];
        }
      }
      return minDistance;
    }

    public double remapDistance(double distance, int xNum, int yNum)
    {
      double maxDistance = Math.Sqrt(Math.Pow(xNum, 2) + Math.Pow(yNum, 2));
      if (distance > maxDistance)
      {
        distance = 1;
      }
      else
      {
        distance = distance / maxDistance;
      }
      return distance;
    }

  }
# ---------- end panelisesurface ----------

# ---- group: HeatmapOfPanelHeight
multiplication = Multiplication(A=number_slider_2, B=number_slider)
series = Series(Start=4, Step=6, Count=multiplication)
gradient = Gradient(
    LowerLimit=0,
    UpperLimit=0.7,
    Parameter=panelisesurface.PanelHeight,
    stops=[0: RGB(234, 38, 0), 0.25: RGB(234, 126, 0), 0.5: RGB(254, 244, 84), 0.75: RGB(173, 203, 249), 1: RGB(75, 107, 169)])
deconstruct_mesh = DeconstructMesh(Mesh=panelisesurface.Meshes)  # -> Vertices, Faces, Colours, Normals
list_item = ListItem(List=deconstruct_mesh.Vertices, Index=series, Wrap=True)
custom_preview = CustomPreview(Geometry=list_item, Material=gradient)

# ----
mesh_edges = MeshEdges(Mesh=panelisesurface.Meshes)  # -> NakedEdges, InteriorEdges, NonManifoldEdges
sphere = Sphere(Base=panelisesurface.attractorPoints, Radius=0.3)
mesh_join = MeshJoin(Meshes=panelisesurface.Meshes)
serializemesh = CSharpScript(mesh=mesh_join)  # -> out, data; inputs mesh: Mesh
# ---------- serializemesh: C# usings ----------
using Rhino.Geometry.Collections;
# ---------- serializemesh: C# ----------
    String type = "TRIANGLE";

    MeshVertexList pts = mesh.Vertices;
    String VerticesCoor = GetVertices(pts);
    String IndexOfPoints = GetIndex(pts);

    String output = type + "\r\n" + VerticesCoor + "\r\n" + IndexOfPoints;
    data = output;
# ---------- serializemesh: C# additional code ----------
  String GetVertices(MeshVertexList pts)
  {
    String VerticesCoor = pts[0].X.ToString() + "," + pts[0].Y.ToString() + "," + pts[0].Z.ToString();
    for (int i = 1; i < pts.Count; i++)
    {
      String XCoor = pts[i].X.ToString();
      String YCoor = pts[i].Y.ToString();
      String ZCoor = pts[i].Z.ToString();
      String str = VerticesCoor + "," + XCoor + "," + YCoor + "," + ZCoor;
      VerticesCoor = str;

    }
    return VerticesCoor;
  }

  String GetIndex(MeshVertexList pts)
  {
    int index = 0;
    String IndexOfPoints = index.ToString();
    for (int i = 0; i < (pts.Count - 1); i++)
    {
      index++;
      String b = IndexOfPoints + "," + index.ToString();
      IndexOfPoints = b;
    }
    return IndexOfPoints;
  }
# ---------- end serializemesh ----------
panel_4 = Panel(serializemesh.data)
